# Dynamo graph DuplicateSheet.dyn (Dynamo 2.6.1.9130)

sheets = Sheets("Title Sheet")
string = StringInput("Test")
duplicateSheet = Sheet.DuplicateSheet(sheet=sheets, prefix=string)
views = Sheet.Views(sheet=duplicateSheet)
